# Grasshopper definition Example2.gh (Grasshopper 1.0.7)
# plug-ins: Ameba

X = Integer(Slider(240, range=0..1000))
Y = Integer(Slider(40, range=0..1000))
X_2 = Integer(X)
Y_2 = Integer(Y)
X_3 = Integer(X)
Y_3 = Integer(Y)
planesrf = PlaneSurface(Plane=PlaneXY(0, 0, 0), XSize=X_2, YSize=Y_2)
login = Login()
points = PointsDomain(
    pointsData_Branch0_Path="{0}",
    pointsData_Branch0_Item0_Coordinate=Point(0, 0, 0),
    pointsData_Branch0_Item1_Coordinate=Point(240, 0, 0))
mesh_uv = MeshSurface(Surface=planesrf, UCount=X_3, VCount=Y_3, Overhang=True, Equalize=False)
pt = Point(Point(120, 40, 0))
item = ListItem(List=points, Index=0, Wrap=True)  # -> Item, Item1
customquadmesh = CustomQuadMesh(FilePath="C:\Users\alber\Documents\Ameba_workspace", ProjectName="2dmbbb", QuadrilateralMesh=mesh_uv)
load2d = Load2D(Domain=pt, Fx=0, Fy="-1", Tolerance="1")
support2d = Support2D(Domain=item.Item1, Ux="0", Uy="0", Tolerance="1")
optparas = BESOOptParameters(Sensitivity=1, Vf="0.5", Ert="0.02", Rmin="2", Steps=300)
support2d_2 = Support2D(Domain=item.Item, Ux="none", Uy="0", Tolerance="1")
mat = Material(Density="1", Elasticity="1", Poisson="0.3", Mat=999)
preprocessing = PreProcessing(
    AmebaMeshFile=customquadmesh,
    Supports=[support2d_2, support2d],
    Loads=load2d,
    Gravity=Vector(0, 0, 0),
    SubDesigndomains="[]",
    Nondesigndomains="[]",
    Symmetry="[]",
    Parameters=optparas,
    Material=mat)
step = Slider(70, range=0..200)
solver = Solver(MeshFile=preprocessing)
display = Display(MeshFile=preprocessing, Step=step, Scale=0, Linear=False, displayColor=0)  # -> Mesh, Value
